# Dynamo graph meshout.dyn (Dynamo 1.3.1.1736)

select_model_elements = DSModelElementsSelection()  # 8 picked in the model
id = Element.Id(select_model_elements)
code_block = CodeBlock(id=id) { "C:\\wamp64\\www\\vrh\\" + id + ".obj"; }
geometry = Element.Geometry(select_model_elements)
byUnion = Solid.ByUnion(geometry)
byOrigin = CoordinateSystem.ByOrigin()
YAxis = Vector.YAxis()
byOriginNormal = Plane.ByOriginNormal(normal=YAxis)
toCoordinateSystem = Plane.ToCoordinateSystem(byOriginNormal)
transform = Geometry.Transform(geometry=byUnion, fromCoordinateSystem=byOrigin, contextCoordinateSystem=toCoordinateSystem)
byGeometry = Autodesk.Dynamo.MeshToolkit.Mesh.ByGeometry(transform)
exportMeshes = Autodesk.Dynamo.MeshToolkit.Mesh.ExportMeshes(code_block, byGeometry, lacing=Longest)
count = Count(select_model_elements)
byOrigin_2 = CoordinateSystem.ByOrigin()
boolean = BoolSelector(false)
getMaterials = Element.GetMaterials(element=select_model_elements, paintMaterials=boolean)
color = Material.Color(getMaterials)
firstItem = List.FirstItem(color, lacing=Longest)
file_path = Filename("..\..\wamp64\www\vrh\index.html")
code_block_2 = CodeBlock { "\n"; }
string = StringInput("""<html xmlns="http://www.w3.org/1999/xhtml"><head>
    <title>RVT OBJ</title>
    <meta name="description" content="Hello, WebVR! - A-Frame" />
    <script src="https://aframe.io/releases/0.6.0/aframe.min.js"></script>
  </head>
  <body class="a-body ">
    <a href="http://truevis.com">truevis.com</a> sample bulding elements from Revit
    """)
code_block_3 = CodeBlock(id=id) { "<a-asset-item id=\"" + id + "\" src=\"" + id + ".obj\"></a-asset-item>"; }
join = String.Join(code_block_2, code_block_3)
string_2 = StringInput("""  
    <a-scene class="fullscreen" canvas="" inspector="" keyboard-shortcuts="" screenshot="" vr-mode-ui="">
        <a-entity position="0 1.6 7.664" camera="active:true;userHeight:1.6; fov: 50" wasd-controls="" rotation="-0.917 25.554 0" look-controls="" aframe-injected="" data-aframe-inspector="default-camera"></a-entity>
        <a-entity light="type: ambient; castShadow: true; intensity: 0.5;" position="0 4.479 0"></a-entity>
        <a-entity light="type: directional;
                         castShadow: true;
                         intensity: 0.4;
                         shadowCameraVisible: false;"
                  position="-9.52 32.301 -20.985"></a-entity>
            """)
lastItem = List.LastItem(color, lacing=Longest)
red = Color.Red(lastItem)
green = Color.Green(lastItem)
blue = Color.Blue(lastItem)
code_block_4 = CodeBlock(id=id, r=red, g=green, b=blue)
# ---------- code_block_4.designscript (2 lines) ----------
"<a-obj-model src=\"#" + id + "\" shadow=\"cast: true;
 receive:true\" material=\"color: rgb(" + r + "," + g + "," + b + ")\"></a-obj-model>";
# ----------------------------------------
join_2 = String.Join(code_block_2, code_block_4)
string_3 = StringInput("""
      </a-scene>
</body></html>""")
join_3 = List.Join(string, join, string_2, join_2, string_3)
join_4 = String.Join(code_block_2, join_3)
writeText = File.WriteText(file_path, join_4)
parameters = Element.Parameters(getMaterials)
